# Grasshopper definition TestAlgorithm.gh (Grasshopper 1.0.4)

path = FilePath("C:\Users\USER\Documents\GitHub\DelaunayVoronoi\DelaunayResults.csv")
path_2 = FilePath("C:\Users\USER\Documents\GitHub\DelaunayVoronoi\VoronoiResults.csv")
file = ReadFile(File=path, PerLineParse=True)
file_2 = ReadFile(File=path_2, PerLineParse=True)
split = TextSplit(Text=file, Separators=",")
split_2 = TextSplit(Text=file_2, Separators=",")
split_3 = SplitTree(Data=simplify(split), Masks=flatten("{!0}"))  # -> Positive, Negative
split_4 = SplitTree(Data=simplify(split_2), Masks=flatten("{!0}"))  # -> Positive, Negative
item = ListItem(List=split_3.Positive, Index=0, Wrap=True)  # -> Item, Item1, Item2, Item3, Item4, Item5
panel = Panel(split_3.Positive)
panel_2 = Panel(split_4.Positive)
item_2 = ListItem(List=split_4.Positive, Index=0, Wrap=True)  # -> Item, Item1, Item2, Item3
pt = ConstructPoint(XCoordinate=[item.Item, item.Item2, item.Item4], YCoordinate=[item.Item1, item.Item3, item.Item5], ZCoordinate=0)
pt_2 = ConstructPoint(XCoordinate=[item_2.Item, item_2.Item2], YCoordinate=[item_2.Item1, item_2.Item3], ZCoordinate=0)
pline = PolyLine(Vertices=pt, Closed=True)
pline_2 = PolyLine(Vertices=pt_2, Closed=True)
area = Area(Geometry=pline)  # -> Area, flatten(Centroid)
voronoi = Voronoi(Points=flatten(pt), BruteForceOverride=False)
